# Dynamo graph 0 AG_MultiSiteProject_v1.1.dyn "0 AG_MultiSiteProject_v1.1_Clean" (Dynamo 2.12.0.5650)
# packages: archi-lab.net 2023.213.1523, RIE 2021.7.1

# group: Get project parameter value
categories = Categories("OST_ProjectInformation")
all_elements_of_category = ElementsOfCategory(Category=categories)
code_block = CodeBlock { "MS_ Multi Site"; }
getParameterValueByName = Element.GetParameterValueByName(element=all_elements_of_category, parameterName=code_block)
firstItem = List.FirstItem(list=getParameterValueByName)

# group: Get project parameter value
categories_2 = Categories("OST_ProjectInformation")
all_elements_of_category_2 = ElementsOfCategory(Category=categories_2)
code_block_2 = CodeBlock { "MS_ Site ID"; }
getParameterValueByName_2 = Element.GetParameterValueByName(element=all_elements_of_category_2, parameterName=code_block_2)
firstItem_2 = List.FirstItem(list=getParameterValueByName_2)

# group: Get project parameter value
categories_3 = Categories("OST_ProjectInformation")
all_elements_of_category_3 = ElementsOfCategory(Category=categories_3)
code_block_3 = CodeBlock { "Lot & Block"; }
getParameterValueByName_3 = Element.GetParameterValueByName(element=all_elements_of_category_3, parameterName=code_block_3)
firstItem_3 = List.FirstItem(list=getParameterValueByName_3)

# group: Get project parameter value
categories_4 = Categories("OST_ProjectInformation")
all_elements_of_category_4 = ElementsOfCategory(Category=categories_4)
code_block_4 = CodeBlock { "MS_ Lot & Block 1"; }
getParameterValueByName_4 = Element.GetParameterValueByName(element=all_elements_of_category_4, parameterName=code_block_4)
firstItem_4 = List.FirstItem(list=getParameterValueByName_4)

# group: Get project parameter value
categories_5 = Categories("OST_ProjectInformation")
all_elements_of_category_5 = ElementsOfCategory(Category=categories_5)
code_block_5 = CodeBlock { "MS_ Lot & Block 2"; }
getParameterValueByName_5 = Element.GetParameterValueByName(element=all_elements_of_category_5, parameterName=code_block_5)
firstItem_5 = List.FirstItem(list=getParameterValueByName_5)

# group: Get project parameter value
categories_6 = Categories("OST_ProjectInformation")
all_elements_of_category_6 = ElementsOfCategory(Category=categories_6)
code_block_6 = CodeBlock { "MS_ Lot & Block 3"; }
getParameterValueByName_6 = Element.GetParameterValueByName(element=all_elements_of_category_6, parameterName=code_block_6)
firstItem_6 = List.FirstItem(list=getParameterValueByName_6)

# group: Lot & Block
python_script = Python(IN[0]=firstItem, IN[1]=firstItem_2, IN[2]=firstItem_3, IN[3]=firstItem_4, IN[4]=firstItem_5, IN[5]=firstItem_6)  # IronPython2
# ---------- python_script.python (35 lines) ----------
# Load the Python Standard and DesignScript Libraries
import sys
import clr
clr.AddReference('ProtoGeometry')
from Autodesk.DesignScript.Geometry import *

# The inputs to this node will be stored as a list in the IN variables.
dataEnteringNode = IN

# Place your code below this line
multiSite = IN[0]
siteID = IN[1]
default = IN[2]
id_1 = IN[3]
id_2 = IN[4]
id_3 = IN[5]
output = None

if(multiSite == 0):
	output = default

elif(multiSite == 1 and siteID == 1):
	output = id_1

elif(multiSite == 1 and siteID == 2):
	output = id_2
	
elif(multiSite == 1 and siteID == 3):
	output = id_3
	
else:
	output = "<ID ERROR>"

# Assign your output to the OUT variable.
OUT = output
# ----------------------------------------

# group: Set Project Parameter Value
categories_7 = Categories("OST_ProjectInformation")
all_elements_of_category_7 = ElementsOfCategory(Category=categories_7)
firstItem_7 = List.FirstItem(list=all_elements_of_category_7)
code_block_7 = CodeBlock { "Lot & Block"; }
setParameterByName = Element.SetParameterByName(element=firstItem_7, parameterName=code_block_7, value=python_script)

# group: Get project parameter value
categories_8 = Categories("OST_ProjectInformation")
all_elements_of_category_8 = ElementsOfCategory(Category=categories_8)
code_block_8 = CodeBlock { "Project Address"; }
getParameterValueByName_7 = Element.GetParameterValueByName(element=all_elements_of_category_8, parameterName=code_block_8)
firstItem_8 = List.FirstItem(list=getParameterValueByName_7)

# group: Get project parameter value
categories_9 = Categories("OST_ProjectInformation")
all_elements_of_category_9 = ElementsOfCategory(Category=categories_9)
code_block_9 = CodeBlock { "MS_ Address 1"; }
getParameterValueByName_8 = Element.GetParameterValueByName(element=all_elements_of_category_9, parameterName=code_block_9)
firstItem_9 = List.FirstItem(list=getParameterValueByName_8)

# group: Get project parameter value
categories_10 = Categories("OST_ProjectInformation")
all_elements_of_category_10 = ElementsOfCategory(Category=categories_10)
code_block_10 = CodeBlock { "MS_ Address 2"; }
getParameterValueByName_9 = Element.GetParameterValueByName(element=all_elements_of_category_10, parameterName=code_block_10)
firstItem_10 = List.FirstItem(list=getParameterValueByName_9)

# group: Get project parameter value
categories_11 = Categories("OST_ProjectInformation")
all_elements_of_category_11 = ElementsOfCategory(Category=categories_11)
code_block_11 = CodeBlock { "MS_ Address 3"; }
getParameterValueByName_10 = Element.GetParameterValueByName(element=all_elements_of_category_11, parameterName=code_block_11)
firstItem_11 = List.FirstItem(list=getParameterValueByName_10)

# group: Address
python_script_2 = Python(IN[0]=firstItem, IN[1]=firstItem_2, IN[2]=firstItem_8, IN[3]=firstItem_9, IN[4]=firstItem_10, IN[5]=firstItem_11)  # IronPython2
# ---------- python_script_2.python (46 lines) ----------
# Load the Python Standard and DesignScript Libraries
import sys
import clr
clr.AddReference('ProtoGeometry')
from Autodesk.DesignScript.Geometry import *

# The inputs to this node will be stored as a list in the IN variables.
dataEnteringNode = IN

# Place your code below this line
# Load the Python Standard and DesignScript Libraries
import sys
import clr
clr.AddReference('ProtoGeometry')
from Autodesk.DesignScript.Geometry import *

# The inputs to this node will be stored as a list in the IN variables.
dataEnteringNode = IN

# Place your code below this line
multiSite = IN[0]
siteID = IN[1]
default = IN[2]
id_1 = IN[3]
id_2 = IN[4]
id_3 = IN[5]
output = None

if(multiSite == 0):
	output = default

elif(multiSite == 1 and siteID == 1):
	output = id_1

elif(multiSite == 1 and siteID == 2):
	output = id_2
	
elif(multiSite == 1 and siteID == 3):
	output = id_3
	
else:
	output = "<ID ERROR>"


# Assign your output to the OUT variable.
OUT = output
# ----------------------------------------

# group: Set Project Parameter Value
categories_12 = Categories("OST_ProjectInformation")
all_elements_of_category_12 = ElementsOfCategory(Category=categories_12)
firstItem_12 = List.FirstItem(list=all_elements_of_category_12)
code_block_12 = CodeBlock { "Project Address"; }
setParameterByName_2 = Element.SetParameterByName(element=firstItem_12, parameterName=code_block_12, value=python_script_2)

element_types = ElementTypes("View")
all_elements_of_type = ElementsOfType(element_class=element_types)

# group: Unhide Groups In All Views
code_block_13 = CodeBlock { true; }
eq = code_block_13 == firstItem
element_types_2 = ElementTypes("Group")
all_elements_of_type_2 = ElementsOfType(element_class=element_types_2)
code_block_14 = CodeBlock(i=all_elements_of_type_2) { i.Name; }
code_block_15 = CodeBlock { "_MS-"; }
contains = String.Contains(string=code_block_14, searchFor=code_block_15)
filterByBoolMask = List.FilterByBoolMask(list=all_elements_of_type_2, mask=contains)
getMembers = Group.GetMembers(group=filterByBoolMask.in)
code_block_16 = CodeBlock { null; }
if_ = RefactoredIf(test=eq, true=getMembers, false=code_block_16)
unHideElements = archilab.Revit.Views.Views.UnHideElements(view=all_elements_of_type, elements=if_, lacing=CrossProduct)
element_types_3 = ElementTypes("View")
all_elements_of_type_3 = ElementsOfType(element_class=element_types_3)

python_script_3 = Python(IN[0]=all_elements_of_type, IN[1]=unHideElements)  # IronPython2
# ---------- python_script_3.python (13 lines) ----------
# Load the Python Standard and DesignScript Libraries
import sys
import clr
clr.AddReference('ProtoGeometry')
from Autodesk.DesignScript.Geometry import *

# The inputs to this node will be stored as a list in the IN variables.
dataEnteringNode = IN

# Place your code below this line

# Assign your output to the OUT variable.
OUT = IN[0]
# ----------------------------------------

# group: If this then that...
code_block_17 = CodeBlock { 1; }
eq_2 = code_block_17 == firstItem_2
code_block_18 = CodeBlock()
# ---------- code_block_18.designscript (2 lines) ----------
["_MS-2_",
"_MS-3_"];
# ----------------------------------------
code_block_19 = CodeBlock { null; }
if_2 = RefactoredIf(test=eq_2, true=code_block_18, false=code_block_19)

# group: If this then that...
code_block_20 = CodeBlock { 2; }
eq_3 = code_block_20 == firstItem_2
code_block_21 = CodeBlock()
# ---------- code_block_21.designscript (2 lines) ----------
["_MS-1_",
"_MS-3_"];
# ----------------------------------------
code_block_22 = CodeBlock { null; }
if_3 = RefactoredIf(test=eq_3, true=code_block_21, false=code_block_22)

# group: If this then that...
code_block_23 = CodeBlock { 3; }
eq_4 = code_block_23 == firstItem_2
code_block_24 = CodeBlock()
# ---------- code_block_24.designscript (2 lines) ----------
["_MS-1_",
"_MS-2_"];
# ----------------------------------------
code_block_25 = CodeBlock { null; }
if_4 = RefactoredIf(test=eq_4, true=code_block_24, false=code_block_25)

list_create = List.Create(item0=if_2, item1=if_3, item2=if_4)
code_block_26 = CodeBlock { 1; }
flatten = List.Flatten(list=list_create, amount=code_block_26)
RIE_RemoveNulls = Custom[RIE_RemoveNulls](list=flatten)  # package RIE; Removes Nulls from list, and outputs a clean list as well as a list of indices that contained nulls in input list
lastItem = List.LastItem(list=RIE_RemoveNulls.CleanList)

# group: Hide Groups In All Views
element_types_4 = ElementTypes("View")
all_elements_of_type_4 = ElementsOfType(element_type=element_types_4)
code_block_27 = CodeBlock { true; }
eq_5 = code_block_27 == firstItem
element_types_5 = ElementTypes("Group")
all_elements_of_type_5 = ElementsOfType(element_type=element_types_5)
code_block_28 = CodeBlock(i=all_elements_of_type_5) { i.Name; }
code_block_29 = CodeBlock(i=lastItem) { i; }
contains_2 = String.Contains(string=code_block_28, searchFor=code_block_29)
filterByBoolMask_2 = List.FilterByBoolMask(list=all_elements_of_type_5, mask=contains_2)
getMembers_2 = Group.GetMembers(group=filterByBoolMask_2.in)
code_block_30 = CodeBlock { null; }
if_5 = RefactoredIf(test=eq_5, true=getMembers_2, false=code_block_30)
hideElements = archilab.Revit.Views.Views.HideElements(view=python_script_3, elements=if_5, lacing=CrossProduct)

firstItem_13 = List.FirstItem(list=RIE_RemoveNulls.CleanList)

# group: Hide Groups In All Views
element_types_6 = ElementTypes("View")
all_elements_of_type_6 = ElementsOfType(element_type=element_types_6)
code_block_31 = CodeBlock { true; }
eq_6 = code_block_31 == firstItem
element_types_7 = ElementTypes("Group")
all_elements_of_type_7 = ElementsOfType(element_type=element_types_7)
code_block_32 = CodeBlock(i=all_elements_of_type_7) { i.Name; }
code_block_33 = CodeBlock(i=firstItem_13) { i; }
contains_3 = String.Contains(string=code_block_32, searchFor=code_block_33)
filterByBoolMask_3 = List.FilterByBoolMask(list=all_elements_of_type_7, mask=contains_3)
getMembers_3 = Group.GetMembers(group=filterByBoolMask_3.in)
code_block_34 = CodeBlock { null; }
if_6 = RefactoredIf(test=eq_6, true=getMembers_3, false=code_block_34)
hideElements_2 = archilab.Revit.Views.Views.HideElements(view=python_script_3, elements=if_6, lacing=CrossProduct)
