# Dynamo graph 0 AG_Specialties SCHD_ALL CAPS.dyn "AG_SPECIALTIES SCHD_ALL CAPS" (Dynamo 2.5.0.7460)

categories = Categories("OST_SpecialityEquipment")
all_elements_of_category = ElementsOfCategory(Category=categories)
elementType = Element.ElementType(element=all_elements_of_category)
code_block = CodeBlock { "Type Comments"; }
getParameterValueByName = Element.GetParameterValueByName(element=elementType, parameterName=code_block)
toUpper = String.ToUpper(str=getParameterValueByName)
setParameterByName = Element.SetParameterByName(element=elementType, parameterName=code_block, value=toUpper)
code_block_2 = CodeBlock { "Manufacturer"; }
getParameterValueByName_2 = Element.GetParameterValueByName(element=elementType, parameterName=code_block_2)
toUpper_2 = String.ToUpper(str=getParameterValueByName_2)
setParameterByName_2 = Element.SetParameterByName(element=elementType, parameterName=code_block_2, value=toUpper_2)
code_block_3 = CodeBlock { "Description"; }
getParameterValueByName_3 = Element.GetParameterValueByName(element=elementType, parameterName=code_block_3)
toUpper_3 = String.ToUpper(str=getParameterValueByName_3)
setParameterByName_3 = Element.SetParameterByName(element=elementType, parameterName=code_block_3, value=toUpper_3)
code_block_4 = CodeBlock { "Model"; }
getParameterValueByName_4 = Element.GetParameterValueByName(element=elementType, parameterName=code_block_4)
toUpper_4 = String.ToUpper(str=getParameterValueByName_4)
setParameterByName_4 = Element.SetParameterByName(element=elementType, parameterName=code_block_4, value=toUpper_4)
