# Dynamo graph 0_AG Extra R@Nd0m Parameters_v3.dyn "0_AG Extra R@Nd0m Parameters_v2" (Dynamo 2.12.0.5650)

name_of_the_component_with_the = StringInput("EXAMPLE_COMPONENT_1")  # "NAME OF THE COMPONENT WITH THE PARAMETER YOU WANT TO EDIT"; graph input
byName = FamilyType.ByName(name=name_of_the_component_with_the)
byFamilyType = FamilyInstance.ByFamilyType(familyType=byName)
watch = Watch(byFamilyType)
numeric_parameter_values_ex_1_2 = BoolSelector(false)  # "NUMERIC PARAMETER VALUES? (EX: "1,2,3,4" IS NUMBERIC AND "Red,Blue,Green" IS NOT)"; graph input
list_of_parameter_values = StringInput("1BLUE,1GREEN,1RED,1YELLOW")  # "LIST OF PARAMETER VALUES SEPERATED BY A COMMA (EX: "Blue Material,Red Material,Green Material,ETC...")"; graph input
input_list = CodeBlock { ","; }
split = String.Split(string=list_of_parameter_values, separator0=input_list)
toNumber = String.ToNumber(string=split)
if_ = If(test=numeric_parameter_values_ex_1_2, true=toNumber, false=split)
code_block = CodeBlock { 1; }
count = List.Count(list=byFamilyType)
count_2 = List.Count(list=if_)
div = count / count_2
add = code_block + div
cycle = List.Cycle(list=if_, amount=add)
watch_2 = Watch(cycle)
watch_3 = Watch(count)
watch_4 = Watch(count_2)
watch_5 = Watch(split)
watch_6 = Watch(if_)
name_of_parameter_you_want_to = StringInput("MATERIAL")  # "NAME OF PARAMETER YOU WANT TO EDIT"; graph input
extra_random_true_force_non = BoolSelector(true)  # "Extra Random? (True = Force Non-repeating)"; graph input
shuffle = List.Shuffle(list=cycle)
python_script = Python(IN[0]=shuffle, IN[1]=if_)  # IronPython2
# ---------- python_script.python (80 lines) ----------
# Enable Python support and load DesignScript library
import clr
clr.AddReference('ProtoGeometry')
from Autodesk.DesignScript.Geometry import *

clr.AddReference("RevitAPIUI")
from Autodesk.Revit.UI import TaskDialog

# The inputs to this node will be stored as a list in the IN variables.
dataEnteringNode = IN

# Place your code below this line

inputList = IN[0]
parameterValue = IN[1]

newList = []
index = 0

msgBox = TaskDialog

while (index < len(inputList)):

	if (index != len(inputList) - 1) and (index != 0):

		if ((inputList[index] == inputList[index + 1]) and (inputList[index] != newList[index - 1])
		or (inputList[index] == newList[index - 1]) and (inputList[index] != inputList[index + 1])):

			if (inputList[index] != parameterValue[0]) and (newList[index - 1] != parameterValue[0]):
				newList.append(parameterValue[0])

			elif (inputList[index] == parameterValue[0]) and (newList[index - 1] != parameterValue[1]):
				newList.append(parameterValue[1])

			elif (inputList[index] == parameterValue[0]) and (newList[index - 1] != parameterValue[2]):
				newList.append(parameterValue[2])

			elif (inputList[index] == parameterValue[1]) and (newList[index - 1] == parameterValue[0]):
				newList.append(parameterValue[2])

			elif (inputList[index] == parameterValue[2]) and (newList[index - 1] == parameterValue[0]):
				newList.append(parameterValue[1])

			else:
				if (newList[index - 1] != parameterValue[0]):
					newList.append(parameterValue[0])

				elif (newList[index - 1] != parameterValue[1]):

					newList.append(parameterValue[1])

				elif (newList[index - 1] != parameterValue[2]):
					newList.append(parameterValue[3])

		elif ((inputList[index] == inputList[index + 1]) and (inputList[index] == newList[index - 1])):

			if (inputList[index] == parameterValue[0]):
				newList.append(parameterValue[1])

			elif (inputList[index] == parameterValue[1]):
				newList.append(parameterValue[2])	

			elif (inputList[index] == parameterValue[2]):
				newList.append(parameterValue[1])	

			else:
				msgBox.Show("Extra R@Nd0m Parameter Generator","Error Code: E100\n\nPlease email this information to contact@ArthurGanem.com")	

		else:
			newList.append(inputList[index])

	else:
		newList.append(inputList[index])

	index += 1

#msgBox.Show("Extra R@Nd0m Parameters","Finished generating non repeating parameter values.")

# Assign your output to the OUT variable.
OUT = newList
# ----------------------------------------
watch_7 = Watch(shuffle)
if_2 = If(test=extra_random_true_force_non, true=python_script, false=watch_7)
watch_8 = Watch(if_2)
setParameterByName = Element.SetParameterByName(element=byFamilyType, parameterName=name_of_parameter_you_want_to, value=watch_8)
byName_2 = Material.ByName(name=watch_8)
setParameterByName_2 = Element.SetParameterByName(element=byFamilyType, parameterName=name_of_parameter_you_want_to, value=byName_2)
if_3 = If(test=numeric_parameter_values_ex_1_2, true=setParameterByName, false=setParameterByName_2)
