# Dynamo graph 0_AG slipSheet v2.dyn (Dynamo 2.12.0.5650)

# group: ADD PREFIX
categories = Categories("OST_Sheets")
all_elements_of_category = ElementsOfCategory(Category=categories)
sheetNumber = Sheet.SheetNumber()  # unwired: sheet
sortByFunction = List.SortByFunction(list=all_elements_of_category, sortFunction=sheetNumber)
code_block = CodeBlock { "Sheet Number"; }
getParameterValueByName = Element.GetParameterValueByName(element=sortByFunction, parameterName=code_block)
sheetNumber_2 = Sheet.SheetNumber()  # unwired: sheet
watch = Watch(sortByFunction)
watch_2 = Watch(getParameterValueByName)

discipline_prefix = StringInput("A-")  # graph input
python_script = Python(IN[0]=getParameterValueByName, IN[1]=discipline_prefix)  # IronPython2
# ---------- python_script.python (63 lines) ----------
# Enable Python support and load DesignScript library
import clr
clr.AddReference('ProtoGeometry')
from Autodesk.DesignScript.Geometry import *

clr.AddReference("RevitAPIUI")
from Autodesk.Revit.UI import TaskDialog

# The inputs to this node will be stored as a list in the IN variables.
dataEnteringNode = IN

# Place your code below this line

import sys
pyt_path = r'C:\\Program Files (x86)\\IronPython 2.7\\Lib'
sys.path.append(pyt_path)

import string

inputListSheetName = IN[0]
prefix = IN[1]
newListSheetName = []

index = 0

while (index < len(inputListSheetName)):

	sheetName = inputListSheetName[index]
		
	if (string.find(sheetName,prefix) != -1 and string.find(sheetName,".") == -1):

		oldSheetNumber = string.replace(sheetName,prefix,"")

		if (len(oldSheetNumber) == 1):
			newSheetNumber = "00{}.0".format(oldSheetNumber)
			newListSheetName.append(prefix + newSheetNumber)

		if (len(oldSheetNumber) == 2):
			newSheetNumber = "0{}.0".format(oldSheetNumber)
			newListSheetName.append(prefix + newSheetNumber)

		if (len(oldSheetNumber) == 3):
			newSheetNumber = "0{}.0".format(oldSheetNumber)
			newListSheetName.append(prefix + newSheetNumber)
		
	if (string.find(sheetName,prefix) != -1 and string.find(sheetName,".") != -1):

		oldSheetNumber = string.replace(sheetName,prefix,"")

		if (len(oldSheetNumber) == 3) or (len(oldSheetNumber) == 4) or (len(oldSheetNumber) == 5):
			location = sheetName[string.find(sheetName,prefix) + 2]
			newSheetNumber = "00{}".format(oldSheetNumber)
			newListSheetName.append(prefix + newSheetNumber)

	if (string.find(sheetName,prefix) == -1):
		newListSheetName.append(sheetName)

	
	index += 1


# Assign your output to the OUT variable.
OUT = newListSheetName
# ----------------------------------------

# group (continued): ADD PREFIX
setParameterByName = Element.SetParameterByName(element=sortByFunction, parameterName=code_block, value=python_script)
sortByFunction_2 = List.SortByFunction(list=setParameterByName, sortFunction=sheetNumber_2)
watch_3 = Watch(python_script)
getParameterValueByName_2 = Element.GetParameterValueByName(element=sortByFunction_2, parameterName=code_block)
watch_4 = Watch(getParameterValueByName_2)

sheetNumber_3 = Sheet.SheetNumber()  # unwired: sheet
sortByFunction_3 = List.SortByFunction(list=sortByFunction_2, sortFunction=sheetNumber_3)
watch_5 = Watch(sortByFunction_3)
code_block_2 = CodeBlock { "Sheet Number"; }
getParameterValueByName_3 = Element.GetParameterValueByName(element=sortByFunction_3, parameterName=code_block_2)
watch_6 = Watch(getParameterValueByName_3)
code_block_3 = CodeBlock { ""; ".0"; }
sheet_number = StringInput("2")  # graph input

# group: ADD PREFIX TO USER INPUT OF SHEET TO BE INSERTED
length = String.Length(string=sheet_number)
code_block_4 = CodeBlock { 1; }
eq = length == code_block_4
code_block_5 = CodeBlock(A=sheet_number) { "00"+A; A; }
if_ = If(test=eq, true=code_block_5.out0, false=code_block_5.A)
length_2 = String.Length(string=if_)
code_block_6 = CodeBlock { 2; }
eq_2 = length_2 == code_block_6
code_block_7 = CodeBlock(A=if_) { "0"+A; A; }
if_2 = If(test=eq_2, true=code_block_7.out0, false=code_block_7.A)
watch_7 = Watch(if_)
watch_8 = Watch(if_2)

join = String.Join(separator=code_block_3.out0, string0=discipline_prefix, string1=if_2, string2=code_block_3.out1)
watch_9 = Watch(join)
indexOf = List.IndexOf(list=watch_6, element=watch_9)
watch_10 = Watch(indexOf)
count = List.Count(list=watch_6)
slice = List.Slice(list=watch_6, start=indexOf, end=count)
watch_11 = Watch(slice)
toNumber = String.ToNumber(string=sheet_number)
python_script_slipsheet = Python(IN[0]=watch_11, IN[1]=discipline_prefix, IN[2]=toNumber)  # IronPython2
# ---------- python_script_slipsheet.python (54 lines) ----------
# Enable Python support and load DesignScript library
import clr
clr.AddReference('ProtoGeometry')
from Autodesk.DesignScript.Geometry import *

clr.AddReference("RevitAPIUI")
from Autodesk.Revit.UI import TaskDialog

# The inputs to this node will be stored as a list in the IN variables.
dataEnteringNode = IN

# Place your code below this line

import sys
pyt_path = r'C:\\Program Files (x86)\\IronPython 2.7\\Lib'
sys.path.append(pyt_path)

import string

inputList = IN[0]
discipline = IN[1]
sheetNumber = IN[2]

newList = []
index = 0 


while (index < len(inputList)):

	sheetName = inputList[index]

	if (sheetName[0] == discipline[0]) and (sheetName[1] == discipline[1]) and (string.find(sheetName,".0") != -1):

		if (len(sheetName) == 7):
			newSheetNumber= "00{}.0".format(sheetNumber)
			newList.append(discipline + newSheetNumber)
			sheetNumber += 1

	if (sheetName[0] == discipline[0]) and (sheetName[1] == discipline[1]) and (string.find(sheetName,".0") == -1):
		if (len(sheetName) == 7):
			#ULTRA GHETTO FIX FOW... (ONLY ADDS 1 TO .1 SHEETS HERE, REST IN DYNAMO DESIGN SCRIPT)
			newSheetNumber= "00{}.{}".format(sheetNumber, sheetName[len(sheetName)-1])
			newList.append(discipline + newSheetNumber)
			#sheetNumber += 1

	index += 1
	
newSheetNumber= "00{}.0".format(sheetNumber)
newList.append(discipline + newSheetNumber)



# Assign your output to the OUT variable.
OUT = newList
# ----------------------------------------
watch_12 = Watch(python_script_slipsheet)
count_2 = List.Count(list=watch_12)
code_block_8 = CodeBlock { 1; }
sub = count_2 - code_block_8
code_block_9 = CodeBlock { 0; }
slice_2 = List.Slice(list=watch_6, start=code_block_9, end=indexOf)
watch_13 = Watch(slice_2)
count_3 = List.Count(list=watch_13)
add = sub + count_3
watch_14 = Watch(add)
code_block_10 = CodeBlock { 1; }
slice_3 = List.Slice(list=watch_12, start=code_block_10, end=count_2)
watch_15 = Watch(slice_3)
join_2 = List.Join(list0=watch_13, list1=watch_15)
slice_4 = List.Slice(list=sortByFunction_3, start=count_3, end=add)
watch_16 = Watch(slice_4)
reverse = List.Reverse(list=watch_16)
reverse_2 = List.Reverse(list=watch_15)
setParameterByName_2 = Element.SetParameterByName(element=reverse, parameterName=code_block_2, value=reverse_2)

# group: REMOVE PREFIX
python_script_remove_prefix = Python(IN[0]=join_2, IN[1]=discipline_prefix, IN[2]=setParameterByName_2)  # IronPython2
# ---------- python_script_remove_prefix.python (58 lines) ----------
# Enable Python support and load DesignScript library
import clr
clr.AddReference('ProtoGeometry')
from Autodesk.DesignScript.Geometry import *

clr.AddReference("RevitAPIUI")
from Autodesk.Revit.UI import TaskDialog

# The inputs to this node will be stored as a list in the IN variables.
dataEnteringNode = IN

# Place your code below this line

import sys
pyt_path = r'C:\\Program Files (x86)\\IronPython 2.7\\Lib'
sys.path.append(pyt_path)

import string

inputListSheetName = IN[0]
prefix = IN[1]
bsInput = IN[2]
newListSheetName = []
noZero = None


index = 0

while (index < len(inputListSheetName)):

	sheetName = inputListSheetName[index]

	if (string.find(sheetName,prefix) != -1):

		withZero = string.replace(sheetName,prefix,"")

		if(withZero[0]=='0' and withZero[1]!='0'):
			noZero = string.replace(withZero,"0","",1)
		
		if(withZero[0]=='0' and withZero[1]=='0'):
			noZero = string.replace(withZero,"00","",1)

		decimalZeroLocation = len(sheetName) - 1

		if(sheetName[decimalZeroLocation]=='0'):
			noZero = string.replace(noZero,".0","",1)

		newListSheetName.append(prefix + noZero)

	if (string.find(sheetName,prefix) == -1):
		newListSheetName.append(sheetName)

	
	index += 1


# Assign your output to the OUT variable.
OUT = newListSheetName
# ----------------------------------------
watch_17 = Watch(python_script_remove_prefix)
code_block_11 = CodeBlock { "Sheet Number"; }
setParameterByName_3 = Element.SetParameterByName(element=sortByFunction_3, parameterName=code_block_11, value=python_script_remove_prefix)
sheetNumber_4 = Sheet.SheetNumber()  # unwired: sheet
sortByFunction_4 = List.SortByFunction(list=setParameterByName_3, sortFunction=sheetNumber_4)
getParameterValueByName_4 = Element.GetParameterValueByName(element=sortByFunction_4, parameterName=code_block_11)
watch_18 = Watch(getParameterValueByName_4)
watch_19 = Watch(join_2)
